# Grasshopper definition hotdogjpeg.gh (Grasshopper 1.0.7)

length = Slider(5, range=0..10)
radius = Slider(1, range=0..10)
rise = Slider(0.5, range=0..2)
radius_2 = GetNumber(radius, AtLeast=1, AtMost=1, Maximum=1.797693135e+308, Minimum=-1.797693135e+308, TreeAccess=False)
rise_2 = GetNumber(rise, AtLeast=1, AtMost=1, Maximum=1.797693135e+308, Minimum=-1.797693135e+308, TreeAccess=False)
length_2 = GetNumber(length, AtLeast=1, AtMost=1, Maximum=1.797693135e+308, Minimum=-1.797693135e+308, TreeAccess=False)
max = Maximum(A=length_2, B="4")
max_2 = Maximum(A=rise_2, B="0")
max_3 = Maximum(A=radius_2, B="0.7")
min = Minimum(A=max, B="10")
min_2 = Minimum(A=max_2, B="1.2")
min_3 = Minimum(A=max_3, B="1.2")
division = Division(A=min, B=3)
multiplication = Multiplication(A=division, B=min_2)
# Sausage
X = UnitX(Factor=min)
Z = UnitZ(Factor=multiplication)
pt = ConstructPoint(XCoordinate=0, YCoordinate=0, ZCoordinate=min_3)
rev = Reverse(Vector=X)
move = Move(Geometry=pt, Motion=X)  # -> Geometry, Transform
move_2 = Move(Geometry=pt, Motion=rev)  # -> Geometry, Transform
move_3 = Move(Geometry=move.Geometry, Motion=Z)  # -> Geometry, Transform
move_4 = Move(Geometry=move_2.Geometry, Motion=Z)  # -> Geometry, Transform
minmax_sauce_from_mid = Panel("0.3 to 0.8")
minmax_sauce_from_mid_2 = Panel("0.4 to 0.7")
_0_5_of_twists_sauce = Panel("3")
arc = Arc3Pt(PointA=move_3.Geometry, PointB=pt, PointC=move_4.Geometry)  # -> Arc, Plane, Radius
range = Range(Domain=minmax_sauce_from_mid, Steps=_0_5_of_twists_sauce)
range_2 = Range(Domain=minmax_sauce_from_mid_2, Steps=_0_5_of_twists_sauce)
pipe = Pipe(Curve=arc.Arc, Radius=min_3, Caps=2)
twists_sauce = Panel("7")
jitter = Jitter(List=range, Jitter=1, Seed=2)  # -> Values, Indices
jitter_2 = Jitter(List=range_2, Jitter=1, Seed="5")  # -> Values, Indices
divide = DivideCurve(Curve=arc.Arc, Count=twists_sauce, Kinks=False)  # -> Points, Tangents, Parameters
alternatepts = Panel("""0
1""")
multiplication_2 = Multiplication(A=min_3, B=jitter_2.Values)
multiplication_3 = Multiplication(A=min_3, B=jitter.Values)
dispatch = Dispatch(List=divide.Points, DispatchPattern=alternatepts)  # -> ListA, ListB
Y = UnitY(Factor=multiplication_2)
Y_2 = UnitY(Factor=multiplication_3)
rev_2 = Reverse(Vector=Y)
rev_3 = Reverse(Vector=Y_2)
move_5 = Move(Geometry=dispatch.ListA, Motion=Y)  # -> Geometry, Transform
move_6 = Move(Geometry=dispatch.ListB, Motion=rev_2)  # -> Geometry, Transform
move_7 = Move(Geometry=dispatch.ListA, Motion=rev_3)  # -> Geometry, Transform
move_8 = Move(Geometry=dispatch.ListB, Motion=Y_2)  # -> Geometry, Transform
weave = Weave(Pattern=[0, 1], Stream0=move_6.Geometry, Stream1=move_5.Geometry, NullGaps=False)
weave_2 = Weave(Pattern=[0, 1], Stream0=move_8.Geometry, Stream1=move_7.Geometry, NullGaps=False)
trim_sauce_from_end = Panel("-.1")
intcrv = Interpolate(Vertices=weave, Degree=3, Periodic=False, KnotStyle=1)  # -> Curve, Length, Domain
intcrv_2 = Interpolate(Vertices=weave_2, Degree=3, Periodic=False, KnotStyle=1)  # -> Curve, Length, Domain
# Sauce
ext = ExtendCurve(Curve=intcrv.Curve, Type=0, Start=trim_sauce_from_end, End="-.5")
ext_2 = ExtendCurve(Curve=intcrv_2.Curve, Type=0, Start="-2.5", End=trim_sauce_from_end)
project = Project(Curve=ext, Brep=pipe, Direction=Vector(0, 0, 1))
project_2 = Project(Curve=ext_2, Brep=pipe, Direction=Vector(0, 0, 1))
end = EndPoints(Curve=project_2)  # -> Start, End
end_2 = EndPoints(Curve=project)  # -> Start, End
pdecon = Deconstruct(Point=end.Start)  # -> XComponent, YComponent, ZComponent
pdecon_2 = Deconstruct(Point=end_2.Start)  # -> XComponent, YComponent, ZComponent
item = ListItem(List=pdecon.ZComponent, Index=0, Wrap=True)  # -> Item, Item1
item_2 = ListItem(List=pdecon_2.ZComponent, Index=0, Wrap=True)  # -> Item, Item1
max_4 = Maximum(A=item.Item, B=item.Item1)
max_5 = Maximum(A=item_2.Item, B=item_2.Item1)
equals = Equality(FirstNumber=pdecon.ZComponent, SecondNumber=max_4)  # -> Equality, Inequality
equals_2 = Equality(FirstNumber=pdecon_2.ZComponent, SecondNumber=max_5)  # -> Equality, Inequality
dispatch_2 = Dispatch(List=project_2, DispatchPattern=equals.Equality)  # -> ListA, ListB
dispatch_3 = Dispatch(List=project, DispatchPattern=equals_2.Equality)  # -> ListA, ListB
sauce_thickness = Panel("0.15")
# Sausage
addition = Addition(A=sauce_thickness, B=0.02)
pipe_2 = Pipe(Curve=dispatch_3.ListA, Radius=sauce_thickness, Caps=2)
pipe_3 = Pipe(Curve=dispatch_2.ListA, Radius=addition, Caps=2)
# BunNapkin
swatch = ColourSwatch(SwatchColor=RGB(228, 171, 90))
mesh = Mesh(pipe_3)
mesh_2 = Mesh(pipe_2)
mesh_3 = Mesh(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)
mesh_4 = Mesh([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])
mesh_5 = Mesh([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])
mcol = MeshColours(Mesh=mesh_2, Colours="yellow")
mcol_2 = MeshColours(Mesh=mesh, Colours="red")
mcol_3 = MeshColours(Mesh=pipe, Colours="#af6042")
mcol_4 = MeshColours(Mesh=mesh_3, Colours=ColourSwatch(SwatchColor=RGB(255, 0, 53)))
mcol_5 = MeshColours(Mesh=mesh_4, Colours=swatch)
mcol_6 = MeshColours(Mesh=mesh_5, Colours="green")
mjoin = MeshJoin(Meshes=flatten([mcol_2, mcol]))
mjoin_2 = MeshJoin(Meshes=flatten([mcol_2, mcol, mcol_3, mcol_4, mcol_5, mcol_6]))
context_bake = ContextBake(Geometry=mcol_3)
context_bake_2 = ContextBake(Geometry=mjoin)
context_bake_3 = ContextBake(Geometry=mjoin_2)
